# Grasshopper definition TEST1.gh (Grasshopper 1.0.7)
# plug-ins: Pufferfish, Wallacei

curve = Curve(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)
offset_curve = OffsetCurve(Curve=curve, Plane=PlaneXY(0, 0, 0), Distance="3", BothSides=0, Kinks=0, CapType=1)
U = Slider(12, range=0..20)
V = Slider(16, range=0..20)

# ---- group: Offset
curve_2 = Curve(offset_curve)

# ----
surface = Surface(curve_2)
divide_surface = DivideSurface(Surface=surface, UCount=U, VCount=V)  # -> Points, Normals, Parameters
flatten_tree = FlattenTree(Tree=divide_surface.Points, Path="{0}")
wlc_seed = Slider(91, range=0..99)
wlc_number = Slider(41, range=1..99)
list_length = ListLength(List=flatten_tree)
random = Random(Range=list_length, Number=wlc_number, Seed=wlc_seed, Integers=True)
list_item = ListItem(List=flatten_tree, Index=random, Wrap=True)
panel = Panel(random)

# ---- group: Location Pts
clean_tree = CleanTree(RemoveNulls=True, RemoveInvalid=True, RemoveEmpty=False, Tree=list_item)

# ----
deconstruct_brep = DeconstructBrep(Brep=surface)  # -> Faces, Edges, Vertices
pull_point = PullPoint(Point=clean_tree, Geometry=curve_2, ClosestOnly=True)  # -> ClosestPoint, Distance
graft_tree = GraftTree(Tree=deconstruct_brep.Edges, IncludeEmptyLists=True, IncludeNullItems=True)  # -> simplify(Tree)
list_length_2 = ListLength(List=graft_tree)
pull_point_2 = PullPoint(Point=pull_point.ClosestPoint, Geometry=graft_tree, ClosestOnly=True)  # -> ClosestPoint, simplify(Distance)
duplicate_data = DuplicateData(Data=clean_tree, Number=list_length_2, Order=True)  # -> simplify(Data)
smaller_than = SmallerThan(FirstNumber=pull_point_2.Distance, SecondNumber="0.001")  # -> SmallerThan, OrEqualTo

# ---- group: Allocate Pts to its Closet Edges
dispatch = Dispatch(List=duplicate_data, DispatchPattern=smaller_than.SmallerThan)  # -> simplify(ListA), simplify(ListB)

# ----
end_points = EndPoints(Curve=graft_tree)  # -> Start, End
panel_2 = Panel(dispatch.ListA)
vector_2pt = Vector2Pt(PointA=end_points.Start, PointB=end_points.End, Unitize=True)  # -> Vector, Length
construct_plane = ConstructPlane(Origin=dispatch.ListA, XAxis=vector_2pt.Vector, YAxis=Vector(0, 1, 0))
clean_tree_2 = CleanTree(RemoveNulls=True, RemoveInvalid=True, RemoveEmpty=True, Tree=construct_plane)
construct_domain = ConstructDomain(DomainStart="5", DomainEnd="20")

# ---- group: Oriented Planes
geometry = Geometry(clean_tree_2)

# ---- group: X Seed
wlc_xseed = Slider(1, range=0..99)
construct_domain_2 = ConstructDomain(DomainStart="0", DomainEnd="99")
list_length_3 = ListLength(List=flatten(geometry))
random_2 = Random(Range=construct_domain_2, Number=list_length_3, Seed=wlc_xseed, Integers=True)  # -> simplify(graft(Random))

# ---- group: Y Seed
construct_domain_3 = ConstructDomain(DomainStart="0", DomainEnd="99")
wlc_yseed = Slider(6, range=0..99)
list_length_4 = ListLength(List=flatten(geometry))
random_3 = Random(Range=construct_domain_3, Number=list_length_4, Seed=wlc_yseed, Integers=True)  # -> simplify(graft(Random))

# ----
list_length_5 = ListLength(List=geometry)
construct_domain_4 = ConstructDomain(DomainStart="5", DomainEnd="15")
list_length_6 = ListLength(List=geometry)
tree_statistics = TreeStatistics(Tree=geometry)  # -> Paths, Length, Count
random_4 = Random(Range=construct_domain, Number=list_length_5, Seed=random_2)  # -> simplify(Random)
random_5 = Random(Range=construct_domain_4, Number=list_length_6, Seed=random_3)  # -> simplify(Random)

# ---- group: X
split_tree = SplitTree(Data=random_4, Masks=flatten(tree_statistics.Paths))  # -> Positive, Negative

# ----
split_tree_2 = SplitTree(Data=random_5, Masks=flatten(tree_statistics.Paths))  # -> Positive, Negative
rectangle = Rectangle(Plane=geometry, XSize=split_tree.Positive, YSize=split_tree_2.Positive, Radius=0)  # -> Rectangle, Length

# ---- group: Bottom
flatten_tree_2 = FlattenTree(Tree=rectangle.Rectangle, Path="{0}")

# ----
list_length_7 = ListLength(List=flatten_tree_2)
duplicate_data_2 = DuplicateData(Data=flatten_tree_2, Number=list_length_7, Order=True)
partition_list = PartitionList(List=duplicate_data_2, Size=list_length_7)  # -> simplify(Chunks)
series = Series(Start=0, Step=1, Count=list_length_7)  # -> simplify(graft(Series))
panel_3 = Panel(partition_list)

# ---- group: Construct List
cull_index = CullIndex(List=partition_list, Indices=series, Wrap=True)  # -> simplify(List)

# ----
graft_tree_2 = GraftTree(Tree=flatten_tree_2, IncludeEmptyLists=True, IncludeNullItems=True)  # -> simplify(Tree)
panel_4 = Panel(cull_index)
curve_curve = CurveCurve(CurveA=graft_tree_2, CurveB=cull_index)  # -> simplify(Points), ParamsA, ParamsB
trim_tree = TrimTree(Tree=curve_curve.Points, Depth=1)
list_length_8 = ListLength(List=trim_tree)
larger_than = LargerThan(FirstNumber=list_length_8, SecondNumber="1")  # -> LargerThan, OrEqualTo
dispatch_2 = Dispatch(List=graft_tree_2, DispatchPattern=larger_than.OrEqualTo)  # -> simplify(ListA), simplify(ListB)

# ---- group: Intersected
geometry_2 = Geometry(flatten(dispatch_2.ListA))

# ---- group: Single Clean
geometry_3 = Geometry(flatten(dispatch_2.ListB))

# ----
region_union = RegionUnion(Curves=geometry_2)  # -> simplify(Result)
entwine = Entwine(Branch00=region_union, Branch01=geometry_3, FlattenInputs=True)  # -> simplify(Result)
curve_3 = Curve(curve_2)
region_intersection = RegionIntersection(CurvesA=entwine, CurvesB=curve_3)  # -> simplify(Result)

# ---- group: Trimmed Results
geometry_4 = Geometry(region_intersection)

# ---- group: Z Seed
wlc_zseed = Slider(46, range=0..99)
construct_domain_5 = ConstructDomain(DomainStart="0", DomainEnd="99")
list_length_9 = ListLength(List=flatten(geometry_4))
random_6 = Random(Range=construct_domain_5, Number=list_length_9, Seed=wlc_zseed, Integers=True)  # -> simplify(graft(Random))

# ----
construct_domain_6 = ConstructDomain(DomainStart="3", DomainEnd="18")
list_length_10 = ListLength(List=geometry_4)
random_7 = Random(Range=construct_domain_6, Number=list_length_10, Seed=random_6, Integers=True)  # -> simplify(Random)
tree_statistics_2 = TreeStatistics(Tree=geometry_4)  # -> Paths, Length, Count
split_tree_3 = SplitTree(Data=random_7, Masks=flatten(tree_statistics_2.Paths))  # -> Positive, Negative
unit_z = UnitZ(Factor=split_tree_3.Positive)
move = Move(Geometry=geometry_4, Motion=unit_z)  # -> simplify(Geometry), Transform
graft_tree_3 = GraftTree(Tree=geometry_4, IncludeEmptyLists=True, IncludeNullItems=True)
graft_tree_4 = GraftTree(Tree=move.Geometry, IncludeEmptyLists=True, IncludeNullItems=True)
merge = Merge(Data1=graft_tree_3, Data2=graft_tree_4)
boundary_surfaces = BoundarySurfaces(Edges=graft_tree_3)
boundary_surfaces_2 = BoundarySurfaces(Edges=graft_tree_4)
loft = Loft(Curves=merge, Options={Adjust=False, Closed=False, LoftEnds=0, LoftSimp=0, LoftType=0, Rebuild=10, Refit=0.01})
merge_2 = Merge(Data1=loft, Data2=boundary_surfaces, Data3=boundary_surfaces_2)

# ---- group: Randomlize Genes
gene_pool_and_slider_shuffler = GenePoolAndSliderShuffler(BooleanButton=Button())

# ---- group: BLocks
brep_join = BrepJoin(Breps=merge_2)  # -> Breps, Closed

# ---- group: Site
surface_2 = Surface(curve)

# ----
point = Point(clean_tree)
